# Grasshopper definition Shade Designer Rhino 6, South Orientation.gh (Grasshopper 1.0.7)
# plug-ins: Human UI, LunchBox

honeybee = Honeybee_Honeybee()  # -> Vviiiiiiiiiizzz; plug-in component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
ladybug = Ladybug_Ladybug()  # -> Vviiiiiiiiiizzz; plug-in component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
launchwin = LaunchWindow(
    Show=Toggle(True),
    Name="Shade Designer",
    Width=Slider(400, range=0..1000),
    Height=Slider(800, range=0..1000),
    ChildStatus=0,
    EnableHorizScroll=False)
winprops = SetWindowProperties(
    Window=launchwin,
    Theme=0,
    ShowTitleBar=True,
    BackgroundColor=ColourSwatch(SwatchColor=RGB(255, 255, 255)),
    ScaleFactor=1)
panel = Panel("Energy Model")
panel_2 = Panel("Weather File")
panel_3 = Panel("3D Shade Mask Calculations")

open_weather_file = Ladybug_OpenEPWWeatherFile(open=Toggle(True))  # -> epwFile; plug-in component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
importepw = Ladybug_ImportEpw(epwFile=open_weather_file)  # -> readMe, latitude, location, dryBulbTemperature, dewPointTemperature, relativeHumidity, windSpeed, windDirection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; plug-in component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

panel_4 = Panel("""C) Once you have the 3D mask sized
for your needs togle the "Bake 3D Mask" 
option below.""")
panel_5 = Panel("""A) Draw a closed profile around an area 
to shade on the layer "Set profile to 
Shade" (likely a window profile or 
part of a window).""")
panel_6 = Panel("""B) Use the "Cooling Cull Threshold"
slider to set how much importance to
give to design for cooling. High values
will cull lower cooling load hours,
making the shade more efficient for 
its size, while low values will capture
more hours to shade reducing the 
cooling load even more at the expense 
of material and perhaps the heating
load.""")
panel_7 = Panel("""A) You should see a preview of a
solid projection from your window 
profile. If not see the debug tab.""")
panel_8 = Panel("""B) Only set one curve at a time. The
curve must be closed and planer. Curves
and other complex geometries may fail.""")
panel_9 = Panel("""C) Toggle the "set Profile to Shade"
button below once your single closed 
curve is drawn on the correct layer.""")
panel_10 = Panel("""A) Either use the default energy model 
built into the script or plug in your 
own energy model using Honeybee and 
Ladybug. See Chris Mackey's Tutorials.""")
panel_11 = Panel("""B) Once the energy model is set, toggle
"Run Baseline Simulation"
""")
panel_12 = Panel("""A) Read the results of the simulations.
Make further design decisions, iterations, modifications, Etc...""")
panel_13 = Panel("""A) Use your 3D mask to trim or generally
size your shading device solution(s).""")
panel_14 = Panel("""B) All of your finished shades should be
set to the "Shading Device" layer. Toggle
the "Set Shades" option below once this is accomplished.""")
panel_15 = Panel("""C) After seting the shades, toggle the
"Run Simulation" option below. """)
chart = CreateChart(
    Data=[Slider(0, range=0..100), Slider(0, range=0..100)],
    Names=["Cooling Load Saved", "Cooling Load"],
    Title="Cooling Load",
    ChartType=3)
toggle = CreateToggle(Default=False, Label="Set Profile to Shade", OnLabel="On", OffLabel="Off")
chart_2 = CreateChart(
    Data=[Slider(0, range=0..100), Slider(0, range=0..100)],
    Names=["Heating Load Increase", "Baseline Heating Load"],
    Title="Heating Load",
    ChartType=3)
chart_3 = CreateChart(
    Data=[Slider(0, range=0..100), Slider(0, range=0..100)],
    Names=["Thermal Load", "Energy Saved"],
    Title="Total Thermal Load",
    ChartType=3)
toggle_2 = CreateToggle(Default=False, Label="Bake 3D Mask", OnLabel="On", OffLabel="Off")
toggle_3 = CreateToggle(Default=False, Label="Set Shades", OnLabel="On", OffLabel="Off")
values = ValueListener(Elements=toggle, SomeProperty=True)  # -> Values, Indices
values_2 = ValueListener(Elements=toggle_3, SomeProperty=True)  # -> Values, Indices
values_3 = ValueListener(Elements=toggle_2, SomeProperty=True)  # -> Values, Indices
layer_ref = LayerReference(ReferenceToggle=values.Values, LayerName="Set Profile to Shade")  # -> Geometry, Name, UserStrings, GUID
layer_ref_2 = LayerReference(ReferenceToggle=values_2.Values, LayerName="Shading Devices")  # -> Geometry, Name, UserStrings, GUID
chartappearance = ChartAppearance(ChartToModify=chart, Colors=[ColourSwatch(SwatchColor=RGB(0, 191, 255)), ColourSwatch(SwatchColor=RGB(0, 0, 255))])
chartappearance_2 = ChartAppearance(ChartToModify=chart_2, Colors=[ColourSwatch(SwatchColor=RGB(255, 0, 0)), ColourSwatch(SwatchColor=RGB(175, 0, 0))])
chartappearance_3 = ChartAppearance(ChartToModify=chart_3, Colors=[ColourSwatch(SwatchColor=RGB(0, 200, 0)), ColourSwatch(SwatchColor=RGB(0, 128, 0))])
bldgprograms = Honeybee_bldgPrograms({"Office": 0, "Retail": 1, "MidriseApartment": 2, "PrimarySchool": 3, "SecondarySchool": 4, "SmallHotel": 5, "LargeHotel": 6, "Hospital": 7, "Outpatient": 8, "Warehouse": 9, "SuperMarket": 10, "FullServiceRestaurant": 11, "QuickServiceRestaurant": 12}, selected="Office")
slider = CreateSlider(
    Slider=Slider(1.5, range=0..100),
    ShowBounds=False,
    ShowTicks=False,
    ShowTooltip=False,
    ShowValLabel=True,
    showLabel=True)
label = CreateLabel(LabelText=panel_4, LabelSize=Slider(12, range=0..100), Justification=0)
panel_16 = Panel("Human UI")
label_2 = CreateLabel(LabelText=panel_6, LabelSize=Slider(12, range=0..100), Justification=0)
toggle_4 = CreateToggle(Default=False, Label="Run Baseline Simulation", OnLabel="On", OffLabel="Off")
label_3 = CreateLabel(LabelText="Cooling Cull Threshold (kWh)", LabelSize=Slider(16, range=0..100), Justification=0)
label_4 = CreateLabel(LabelText=panel_7, LabelSize=Slider(12, range=0..100), Justification=0)
label_5 = CreateLabel(LabelText=panel_8, LabelSize=Slider(12, range=0..100), Justification=0)
label_6 = CreateLabel(LabelText=panel_9, LabelSize=Slider(12, range=0..100), Justification=0)
label_7 = CreateLabel(LabelText=panel_5, LabelSize=Slider(12, range=0..100), Justification=0)
label_8 = CreateLabel(LabelText=panel_10, LabelSize=Slider(12, range=0..100), Justification=0)
label_9 = CreateLabel(LabelText=panel_11, LabelSize=Slider(12, range=0..100), Justification=0)
toggle_5 = CreateToggle(Default=False, Label="Run Simulation", OnLabel="On", OffLabel="Off")
label_10 = CreateLabel(LabelText=panel_12, LabelSize=Slider(12, range=0..100), Justification=0)
label_11 = CreateLabel(LabelText=panel_13, LabelSize=Slider(12, range=0..100), Justification=0)
label_12 = CreateLabel(LabelText=panel_14, LabelSize=Slider(12, range=0..100), Justification=0)
label_13 = CreateLabel(LabelText=panel_15, LabelSize=Slider(12, range=0..100), Justification=0)
expander = CreateExpander(UIElements=[label_10, chart, chart_2, chart_3], Header="Step 5", Open=Toggle(False))
expander_2 = CreateExpander(UIElements=[label_4, label_2, label_3, slider, label, toggle_2], Header="Step 3", Open=Toggle(False))
expander_3 = CreateExpander(UIElements=[label_8, label_9, toggle_4], Header="Step 1", Open=Toggle(True))
expander_4 = CreateExpander(UIElements=[label_7, label_5, label_6, toggle], Header="Step 2", Open=Toggle(False))
expander_5 = CreateExpander(UIElements=[label_11, label_12, toggle_3, label_13, toggle_5], Header="Step 4", Open=Toggle(False))
values_4 = ValueListener(Elements=toggle_4, SomeProperty=True)  # -> Values, Indices
values_5 = ValueListener(Elements=toggle_5, SomeProperty=True)  # -> Values, Indices
values_6 = ValueListener(Elements=slider, SomeProperty=True)  # -> Values, Indices
slider_2 = CreateSlider(Slider=Slider(10, range=0..100), ShowBounds=False, ShowTicks=False, ShowTooltip=False, ShowValLabel=True, showLabel=True)
slider_3 = CreateSlider(
    Slider=Slider(50, range=0..1000),
    ShowBounds=False,
    ShowTicks=False,
    ShowTooltip=False,
    ShowValLabel=True,
    showLabel=True)
slider_4 = CreateSlider(Slider=Slider(10, range=0..200), ShowBounds=False, ShowTicks=False, ShowTooltip=False, ShowValLabel=True, showLabel=True)
label_14 = CreateLabel(LabelText="Divisions (Shape)", LabelSize=Slider(16, range=0..100), Justification=0)
label_15 = CreateLabel(LabelText="Divisions (Profile)", LabelSize=Slider(16, range=0..100), Justification=0)
label_16 = CreateLabel(LabelText="Height of the Cloud", LabelSize=Slider(16, range=0..100), Justification=0)
values_7 = ValueListener(Elements=slider_4, SomeProperty=True)  # -> Values, Indices
values_8 = ValueListener(Elements=slider_3, SomeProperty=True)  # -> Values, Indices
values_9 = ValueListener(Elements=slider_2, SomeProperty=True)  # -> Values, Indices
expander_6 = CreateExpander(Header="Step 6", Open=Toggle(False))
expander_7 = CreateExpander(UIElements=[label_16, slider_4, label_15, slider_3, label_14, slider_2], Header="Debug", Open=Toggle(False))
addelems = AddElements(
    Window=launchwin,
    Elements=flatten([expander_3, expander_4, expander_2, expander_5, expander, expander_7]),
    DoVLChecking=True)  # -> AddedElements, ElementNames

# ----
# SET PROFILE TO SHADE
# Percent Cooling Load Compared to Unshaded
# Percent Heating Load Compared to Unshaded
# Percent Total Thermal Load Compared to Unshaded
panel_17 = Panel("Input Srfs/Breps")
srf = Surface(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)
srf_2 = Surface(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)
panel_18 = Panel("Energy Model Geometry")
srf_3 = Surface([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])
srf_4 = Surface(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)
srf_5 = Surface(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)
panel_19 = Panel("Shading Mask Geometry")
panel_20 = Panel("Quick Outputs")
panel_21 = Panel("SET SHADES")
brep = Brep(layer_ref_2.Geometry)
crv = Curve(layer_ref.Geometry)
panel_22 = Panel("3D MASK")
panel_23 = Panel("Original Cooling Load")
panel_24 = Panel("New Cooling Load")
panel_25 = Panel("Original Heating Load")
panel_26 = Panel("New Heating Load")

dup = DuplicateData(Data=Slider(0, range=0..100), Number=Slider(8760, range=0..10000), Order=True)
entwine = Entwine(
    Branch00=[Toggle(True), Toggle(False), Toggle(False), Toggle(False), Toggle(False), Toggle(False), Toggle(False), Toggle(False), Toggle(False), Toggle(False), Toggle(False), Toggle(False), Toggle(False), Toggle(False), Toggle(False), Toggle(False), Toggle(False), Toggle(False), Toggle(False), Toggle(False), Toggle(False), Toggle(False), Toggle(False), Toggle(False)],
    FlattenInputs=True)
panel_27 = Panel("cooling")
panel_28 = Panel("Heating")
panel_29 = Panel("Total")
panel_30 = Panel(entwine)
shift = ShiftList(List=panel_30, Shift=1, Wrap=True)
shift_2 = ShiftList(List=shift, Shift=1, Wrap=True)
shift_3 = ShiftList(List=shift_2, Shift=1, Wrap=True)
shift_4 = ShiftList(List=shift_3, Shift=1, Wrap=True)
shift_5 = ShiftList(List=shift_4, Shift=1, Wrap=True)
shift_6 = ShiftList(List=shift_5, Shift=1, Wrap=True)
shift_7 = ShiftList(List=shift_6, Shift=1, Wrap=True)
shift_8 = ShiftList(List=shift_7, Shift=1, Wrap=True)
shift_9 = ShiftList(List=shift_8, Shift=1, Wrap=True)
shift_10 = ShiftList(List=shift_9, Shift=1, Wrap=True)
shift_11 = ShiftList(List=shift_10, Shift=1, Wrap=True)
shift_12 = ShiftList(List=shift_11, Shift=1, Wrap=True)
shift_13 = ShiftList(List=shift_12, Shift=1, Wrap=True)
shift_14 = ShiftList(List=shift_13, Shift=1, Wrap=True)
shift_15 = ShiftList(List=shift_14, Shift=1, Wrap=True)
shift_16 = ShiftList(List=shift_15, Shift=1, Wrap=True)
shift_17 = ShiftList(List=shift_16, Shift=1, Wrap=True)
shift_18 = ShiftList(List=shift_17, Shift=1, Wrap=True)
shift_19 = ShiftList(List=shift_18, Shift=1, Wrap=True)
shift_20 = ShiftList(List=shift_19, Shift=1, Wrap=True)
shift_21 = ShiftList(List=shift_20, Shift=1, Wrap=True)
shift_22 = ShiftList(List=shift_21, Shift=1, Wrap=True)
shift_23 = ShiftList(List=shift_22, Shift=1, Wrap=True)
number_slider = Slider(0.2, range=0..100)
number_slider_2 = Slider(1, range=0..1)

callfromepconstrlibrary = Honeybee_CallFromEPConstructionLibrary()  # -> ThermMaterials, EPMaterials, EPWindowMaterials, EPConstructions; plug-in component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
searchepconstruction = Honeybee_SearchEPConstruction(
    EPConstrList=callfromepconstrlibrary.EPConstructions,
    standard=Slider(3, range=0..5),
    climateZone=Slider(4, range=0..12),
    surfaceType=Slider(1, range=0..4))  # -> EPSelectedConstr; plug-in component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
listzoneprograms = Honeybee_ListZonePrograms(bldgProgram=bldgprograms)  # -> OfficeZonePrograms; plug-in component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
searchepconstruction_2 = Honeybee_SearchEPConstruction(
    EPConstrList=callfromepconstrlibrary.EPConstructions,
    standard=Slider(3, range=0..5),
    climateZone=Slider(4, range=0..12),
    surfaceType=Slider(2, range=0..4))  # -> EPSelectedConstr; plug-in component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
searchepconstruction_3 = Honeybee_SearchEPConstruction(
    EPConstrList=callfromepconstrlibrary.EPConstructions,
    standard=Slider(3, range=0..5),
    climateZone=Slider(4, range=0..12),
    surfaceType=Slider(0, range=0..4))  # -> EPSelectedConstr; plug-in component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
searchepconstruction_4 = Honeybee_SearchEPConstruction(
    EPConstrList=callfromepconstrlibrary.EPConstructions,
    standard=Slider(3, range=0..5),
    climateZone=Slider(4, range=0..12),
    surfaceType=Slider(4, range=0..4))  # -> EPSelectedConstr; plug-in component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
panel_31 = Panel("Adiabatic")
panel_32 = Panel(searchepconstruction)
panel_33 = Panel(searchepconstruction_2)
panel_34 = Panel(searchepconstruction_3)
panel_35 = Panel(searchepconstruction_4)
analysisperiod = Ladybug_AnalysisPeriod(
    fromMonth=Slider(1, range=0..1),
    fromDay=Slider(1, range=0..1),
    fromHour=Slider(1, range=0..1),
    toMonth=Slider(12, range=0..100),
    toDay=Slider(31, range=0..100),
    toHour=Slider(24, range=0..100))  # -> readMe, analysisPeriod; plug-in component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
item = ListItem(List=panel_32, Index=Slider(0, range=0..20), Wrap=True)
panel_36 = Panel(item)
item_2 = ListItem(List=panel_33, Index=Slider(0, range=0..20), Wrap=True)
panel_38 = Panel(item_2)
item_3 = ListItem(List=panel_34, Index=Slider(0, range=0..20), Wrap=True)
panel_39 = Panel(item_3)
createhbsrfs = Honeybee_createHBSrfs(geometry=srf_4, srfName="Walls", srfType=Slider(0, range=0..6), EPBC="Outdoors", EPConstruction=panel_39)  # -> readMe, simplify(HBSurface); plug-in component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
item_4 = ListItem(List=panel_35, Index=Slider(0, range=0..20), Wrap=True)
panel_41 = Panel(item_4)
addhbglz = Honeybee_addHBGlz(
    HBObj=createhbsrfs.HBSurface,
    childSurfaces=flatten(srf_5),
    childSurfacesName=flatten("Window"),
    EPConstructions=panel_41)  # -> HBObjWGLZ; plug-in component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
createhbsrfs_2 = Honeybee_createHBSrfs(geometry=srf, srfName="Roof", srfType=Slider(1, range=1..6), EPBC="Outdoors", EPConstruction=panel_36)  # -> readMe, simplify(HBSurface); plug-in component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
createhbsrfs_3 = Honeybee_createHBSrfs(geometry=srf_2, srfName="Floor", srfType=Slider(2, range=1..6), EPBC="Outdoors", EPConstruction=panel_38)  # -> readMe, simplify(HBSurface); plug-in component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
hb_epcontextsrf = HoneybeeEPContextSurfaces(shdSurfaces=flatten(brep))  # -> HBContext; inputs shdSurfaces: list of Brep, justBoundingBox: Boolean
# ---------- hb_epcontextsrf: Python ----------
"""
prepare shading/context geometries

    Args:
        northVectorOrRotation: A vector that shows North or a number that shows
                               the rotation of the North from the Y axis
        bldgMasses: List of closed Breps as thermal zones.
    Returns:
        report: ...
        thermalZones: Thermal zone's geometries for visualiza
"""

ghenv.Component.Name = 'Honeybee EP context Surfaces'
ghenv.Component.NickName = 'HB_EPContextSrf'
ghenv.Component.Message = 'VER 0.0.63\nJAN_20_2018'
ghenv.Component.IconDisplayMode = ghenv.Component.IconDisplayMode.application
ghenv.Component.Category = "Honeybee"
ghenv.Component.SubCategory = "10 | Energy | Energy"
#compatibleHBVersion = VER 0.0.57\nNOV_04_2016
#compatibleLBVersion = VER 0.0.59\nFEB_01_2015
ghenv.Component.AdditionalHelpFromDocStrings = "2"

import rhinoscriptsyntax as rs
import Rhino as rc
import scriptcontext as sc
import os
import System
import Grasshopper.Kernel as gh
import uuid

tolerance = sc.doc.ModelAbsoluteTolerance
import math


def main(shdSurfaces, EPTransSchedule, meshingSettings, justBoundingBox):
    
    # import the classes
    if sc.sticky.has_key('honeybee_release'):

        try:
            if not sc.sticky['honeybee_release'].isCompatible(ghenv.Component): return -1
            if sc.sticky['honeybee_release'].isInputMissing(ghenv.Component): return -1
        except:
            warning = "You need a newer version of Honeybee to use this compoent." + \
            " Use updateHoneybee component to update userObjects.\n" + \
            "If you have already updated userObjects drag Honeybee_Honeybee component " + \
            "into canvas and try again."
            w = gh.GH_RuntimeMessageLevel.Warning
            ghenv.Component.AddRuntimeMessage(w, warning)
            return -1
        
        # don't customize this part
        hb_EPSrf = sc.sticky["honeybee_EPSurface"]
        hb_EPSHDSurface = sc.sticky["honeybee_EPShdSurface"]
        hb_RADMaterialAUX = sc.sticky["honeybee_RADMaterialAUX"]
        hb_EPObjectsAux = sc.sticky["honeybee_EPObjectsAUX"]()
        HBScheduleList = sc.sticky["honeybee_ScheduleLib"].keys()

        ########################################################################
        #----------------------------------------------------------------------#
        shdBreps = []
        # create bounding box of shading geometries
        if justBoundingBox:
            for brep in shdSurfaces:
                if brep.Faces.Count>1 or not brep.Faces[0].IsPlanar(sc.doc.ModelAbsoluteTolerance):
                    shdBreps.append(brep.GetBoundingBox(True).ToBrep())
                else:
                    shdBreps.append(brep)
        else:
            shdBreps = shdSurfaces
        
        shadingClasses = []
        shadingMeshPreview = []
        
        if meshingSettings == None:
            mp = rc.Geometry.MeshingParameters.Minimal
            mp.SimplePlanes = True
        else:
            mp = meshingSettings
        
        def getRadMaterialName(radMaterial):
            nameStr = radMaterial.split(" ")[2]
            name =  nameStr.split("\n")[0]
            return name
        
        for brepCount, brep in enumerate(shdBreps):
            if brep != None:
                isPlanar = True
                # check planarity
                for face in brep.Faces:
                    if not face.IsPlanar(tolerance):
                        isPlanar = False
                        break
                
                shadingBreps = []
                if not isPlanar:
                    meshArray = rc.Geometry.Mesh.CreateFromBrep(brep, mp)
                    for mesh in meshArray:
                        for meshFace in range(mesh.Faces.Count):
                            vertices = list(mesh.Faces.GetFaceVertices(meshFace))[1:]
                            vertices = vertices + [sc.doc.ModelAbsoluteTolerance]
                            # create the brep from mesh
                            shdBrep = rc.Geometry.Brep.CreateFromCornerPoints(*vertices)
                            shadingBreps.append(shdBrep)
                else:
                    for face in brep.Faces:
                        shadingBreps.append(face.DuplicateFace(False))
                
                for faceCount, shdBrep in enumerate(shadingBreps):
                        thisShading = hb_EPSHDSurface(shdBrep, 1000*brepCount + faceCount, 'shdSrf_' + `brepCount` + '_' + `faceCount` + "_" + str(uuid.uuid4()))
                        
                        # add transmittance schedule if any
                        if EPTransSchedule!=None:
                            schedule= EPTransSchedule.upper()
                            if schedule!=None and not schedule.lower().endswith(".csv") and schedule not in HBScheduleList:
                                msg = "Cannot find " + schedule + " in Honeybee schedule library."
                                print msg
                                ghenv.Component.AddRuntimeMessage(gh.GH_RuntimeMessageLevel.Warning, msg)
                                return -1
                            elif schedule!=None and schedule.lower().endswith(".csv"):
                                # check if csv file is existed
                                if not os.path.isfile(schedule):
                                    msg = "Cannot find the shchedule file: " + schedule
                                    print msg
                                    ghenv.Component.AddRuntimeMessage(gh.GH_RuntimeMessageLevel.Warning, msg)
                                    return -1
                            
                            thisShading.TransmittanceSCH = schedule
                        
                        # add the Rad Material if any
                        if RADMaterial!=None:
                            # if it is just the name of the material make sure it is already defined
                            if len(RADMaterial.split(" ")) == 1:
                                # if the material is not in the library add it to the library
                                if not hb_RADMaterialAUX.isMatrialExistInLibrary(RADMaterial):
                                    warningMsg = "Can't find " + RADMaterial + " in RAD Material Library.\n" + \
                                                "Add the material to the library and try again."
                                    ghenv.Component.AddRuntimeMessage(gh.GH_RuntimeMessageLevel.Warning, warningMsg)
                                    return
                                
                                try:
                                    thisShading.setRADMaterial(RADMaterial)
                                except Exception, e:
                                    print e
                                    warningMsg = "You are using an old version of Honeybee_Honeybee! Update your files and try again."
                                    print warningMsg
                                    ghenv.Component.AddRuntimeMessage(gh.GH_RuntimeMessageLevel.Warning, warningMsg)
                                    return
                                
                                addedToLib = True
                            else:
                                
                                # try to add the material to the library
                                addedToLib, thisShading.RadMaterial = hb_RADMaterialAUX.analyseRadMaterials(RADMaterial, True)
                                
                            if addedToLib==False:
                                warningMsg = "Failed to add " + RADMaterial + " to the Library."
                                ghenv.Component.AddRuntimeMessage(gh.GH_RuntimeMessageLevel.Warning, warningMsg)
                                return
                        
                        # add shading to the list
                        shadingClasses.append(thisShading)
                
        # add to the hive
        hb_hive = sc.sticky["honeybee_Hive"]()
        HBContext  = hb_hive.addToHoneybeeHive(shadingClasses, ghenv.Component)
        return HBContext
        ################################################################################################
    else:
        print "You should first let Honeybee to fly..."
        w = gh.GH_RuntimeMessageLevel.Warning
        ghenv.Component.AddRuntimeMessage(w, "You should first let Honeybee to fly...")
        return -1
        

if _shdSurfaces and _shdSurfaces[0]!=None:
    # add cleaning function
    result= main(_shdSurfaces, EPTransSchedule_, meshingSettings_, justBoundingBox_)
    
    if result != -1: HBContext = result
# ---------- end hb_epcontextsrf ----------
createhbsrfs_4 = Honeybee_createHBSrfs(geometry=srf_3, srfName="Walls int", srfType=Slider(0, range=0..6), EPBC="Outdoors", EPConstruction=panel_39)  # -> readMe, simplify(HBSurface); plug-in component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
toggle_6 = BooleanToggle(True)
panel_43 = Panel("annual")
epoutput = Honeybee_GenerateEPOutput(
    zoneEnergyUse=toggle_6,
    zoneGainsAndLosses=toggle_6,
    zoneComfortMetrics="False",
    surfaceTempAnalysis=toggle_6,
    surfaceEnergyAnalysis=toggle_6,
    glazingSolarAnalysis=toggle_6,
    timestep="hourly")  # -> report, flatten(simulationOutputs); plug-in component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

panel_44 = Panel(listzoneprograms)

item_5 = ListItem(List=panel_44, Index=Slider(4, range=0..12), Wrap=True)
createhbzones = Honeybee_createHBZones(
    name="Zone1",
    zoneProgram=item_5,
    HBSurfaces=flatten([createhbsrfs_2.HBSurface, createhbsrfs_3.HBSurface, createhbsrfs_4.HBSurface, addhbglz]),
    isConditioned=True)  # -> readMe, HBZone; plug-in component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
runenergysimulation = Honeybee_RunEnergySimulation(
    epwFile=open_weather_file,
    analysisPeriod=analysisperiod.analysisPeriod,
    HBZones=flatten(createhbzones.HBZone),
    simulationOutputs=flatten(epoutput.simulationOutputs),
    writeIdf=values_4.Values,
    runEnergyPlus=values_4.Values)  # -> readMe, idfFileAddress, resultFileAddress, eioFileAddress, rddFileAddress, htmlReport, studyFolder; plug-in component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
runenergysimulation_2 = Honeybee_RunEnergySimulation(
    epwFile=open_weather_file,
    analysisPeriod=analysisperiod.analysisPeriod,
    HBZones=flatten(createhbzones.HBZone),
    HBContext=flatten(hb_epcontextsrf),
    simulationOutputs=flatten(epoutput.simulationOutputs),
    writeIdf=values_5.Values,
    runEnergyPlus=values_5.Values)  # -> readMe, idfFileAddress, resultFileAddress, eioFileAddress, rddFileAddress, htmlReport, studyFolder; plug-in component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
readepsrfresult = Honeybee_ReadEPSurfaceResult(resultFileAddress=runenergysimulation.resultFileAddress)  # -> surfaceIndoorTemp, surfaceOutdoorTemp, surfaceEnergyFlow, opaqueEnergyFlow, glazEnergyFlow, windowTotalSolarEnergy, windowBeamEnergy, windowDiffEnergy, port, port_2; plug-in component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
readepresult = Honeybee_ReadEPResult(resultFileAddress=runenergysimulation.resultFileAddress)  # -> totalThermalLoad, thermalLoadBalance, cooling, heating, electricLight, electricEquip, port, port_2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; plug-in component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
readepresult_2 = Honeybee_ReadEPResult(resultFileAddress=runenergysimulation_2.resultFileAddress)  # -> totalThermalLoad, thermalLoadBalance, cooling, heating, electricLight, electricEquip, fanElectric, pumpElectric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; plug-in component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

panel_45 = Panel(readepresult_2.heating)
panel_46 = Panel(readepresult_2.cooling)
sunpath = Ladybug_SunPath(
    location=importepw.location,
    hour=12,
    day=21,
    month=12,
    timeStep=1,
    analysisPeriod=analysisperiod.analysisPeriod,
    dailyOrAnnualSunPath=True,
    bakeIt=Toggle(False))  # -> readMe, sunVectors, sunAltitudes, sunAzimuths, port, sunSpheresMesh, sunPathCrvs, compassCrvs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; plug-in component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
vec = Vector(sunpath.sunPositions)
devec = DeconstructVector(Vector=vec)  # -> XComponent, YComponent, ZComponent
panel_47 = Panel(readepresult.heating)
panel_48 = Panel(readepresult.cooling)
panel_49 = Panel(readepresult.totalSolarGain)
division = Division(A=devec.XComponent, B=devec.ZComponent)
division_2 = Division(A=devec.ZComponent, B=devec.ZComponent)
division_3 = Division(A=devec.YComponent, B=devec.ZComponent)
multiplication = Multiplication(A=division, B=values_7.Values)
multiplication_2 = Multiplication(A=division_3, B=values_7.Values)
multiplication_3 = Multiplication(A=division_2, B=values_7.Values)
multiplication_4 = Multiplication(A=sunpath.sunPositionsHOY, B=Slider(1, range=0..1))
replace = ReplaceItems(List=dup, Item=multiplication, Indices=multiplication_4, Wrap=False)
replace_2 = ReplaceItems(List=dup, Item=multiplication_2, Indices=multiplication_4, Wrap=False)
replace_3 = ReplaceItems(List=dup, Item=multiplication_3, Indices=multiplication_4, Wrap=False)
cull_i = CullIndex(List=panel_49, Indices=[0, 1, 2, 3, 4, 5, 6], Wrap=True)
ma = MassAddition(Input=readepresult.totalSolarGain)  # -> Result, PartialResults
cull_i_2 = CullIndex(List=panel_46, Indices=[0, 1, 2, 3, 4, 5, 6], Wrap=True)
cull_i_3 = CullIndex(List=panel_47, Indices=[0, 1, 2, 3, 4, 5, 6], Wrap=True)
cull_i_4 = CullIndex(List=panel_45, Indices=[0, 1, 2, 3, 4, 5, 6], Wrap=True)
cull_i_5 = CullIndex(List=panel_48, Indices=[0, 1, 2, 3, 4, 5, 6], Wrap=True)
panel_50 = Panel(ma.Result)
ma_2 = MassAddition(Input=cull_i_5)  # -> Result, PartialResults
ma_3 = MassAddition(Input=cull_i_3)  # -> Result, PartialResults
ma_4 = MassAddition(Input=cull_i_2)  # -> Result, PartialResults
ma_5 = MassAddition(Input=cull_i_4)  # -> Result, PartialResults
addition = Addition(A=ma_2.Result, B=ma_3.Result)
addition_2 = Addition(A=ma_4.Result, B=ma_5.Result)
addition_3 = Addition(A=cull_i_5, B=Slider(0, range=0..100))
addition_4 = Addition(A=cull_i, B=Slider(0, range=0..100))
addition_5 = Addition(A=cull_i_3, B=Slider(0, range=0..100))
division_4 = Division(A=ma_5.Result, B=ma_3.Result)
division_5 = Division(A=addition_2, B=addition)
division_6 = Division(A=ma_4.Result, B=ma_2.Result)
expression = Expression(x=addition_3, y=addition_4, Expression="If((x/y)>0, x/y, 0)")
expression_2 = Expression(x=addition_5, y=addition_4, Expression="If((x/y)>0, x/y, 0)")
nullrep = ReplaceNulls(Items=expression, Replacements=Slider(0, range=0..100))  # -> Items, Count
nullrep_2 = ReplaceNulls(Items=expression_2, Replacements=Slider(0, range=0..100))  # -> Items, Count
expression_3 = Expression(x=nullrep.Items, Expression="If(x>1, 1, x)")
expression_4 = Expression(x=nullrep_2.Items, Expression="If(x>1, 1, x)")
multiplication_5 = Multiplication(A=addition_4, B=expression_3)
multiplication_6 = Multiplication(A=addition_4, B=expression_4)
expression_5 = Expression(x=multiplication_6, y=number_slider, Expression="If(x<y, 0, x)")
expression_6 = Expression(x=multiplication_6, y=number_slider, Expression="If(x<y, 0, 1)")
multiplication_7 = Multiplication(A=replace_2, B=expression_6)
multiplication_8 = Multiplication(A=replace, B=expression_6)
multiplication_9 = Multiplication(A=replace_3, B=expression_6)
ma_6 = MassAddition(Input=expression_5)  # -> Result, PartialResults
ma_7 = MassAddition(Input=multiplication_6)  # -> Result, PartialResults
division_7 = Division(A=ma_6.Result, B=ma_7.Result)
expression_7 = Expression(x=multiplication_5, y=values_6.Values, Expression="If(x<y, 0, 1)")
expression_8 = Expression(x=multiplication_5, y=values_6.Values, Expression="If(x<y, 0, x)")
ma_8 = MassAddition(Input=expression_8)  # -> Result, PartialResults
ma_9 = MassAddition(Input=multiplication_5)  # -> Result, PartialResults
division_8 = Division(A=ma_8.Result, B=ma_9.Result)
panel_51 = Panel(division_8)
multiplication_10 = Multiplication(A=replace_2, B=expression_7)
cull = CullPattern(List=multiplication_10, CullPattern=shift_7)
cull_2 = CullPattern(List=multiplication_10, CullPattern=shift_8)
cull_3 = CullPattern(List=multiplication_10, CullPattern=shift_10)
cull_4 = CullPattern(List=multiplication_10, CullPattern=shift_9)
cull_5 = CullPattern(List=multiplication_10, CullPattern=shift_11)
cull_6 = CullPattern(List=multiplication_10, CullPattern=shift_22)
cull_7 = CullPattern(List=multiplication_10, CullPattern=shift_5)
cull_8 = CullPattern(List=multiplication_10, CullPattern=shift_6)
cull_9 = CullPattern(List=multiplication_10, CullPattern=shift)
cull_10 = CullPattern(List=multiplication_10, CullPattern=shift_3)
cull_11 = CullPattern(List=multiplication_10, CullPattern=shift_12)
cull_12 = CullPattern(List=multiplication_10, CullPattern=shift_13)
cull_13 = CullPattern(List=multiplication_10, CullPattern=shift_20)
cull_14 = CullPattern(List=multiplication_10, CullPattern=shift_21)
cull_15 = CullPattern(List=multiplication_10, CullPattern=shift_23)
cull_16 = CullPattern(List=multiplication_10, CullPattern=shift_2)
cull_17 = CullPattern(List=multiplication_10, CullPattern=shift_14)
cull_18 = CullPattern(List=multiplication_10, CullPattern=shift_15)
cull_19 = CullPattern(List=multiplication_10, CullPattern=panel_30)
cull_20 = CullPattern(List=multiplication_10, CullPattern=shift_16)
cull_21 = CullPattern(List=multiplication_10, CullPattern=shift_19)
cull_22 = CullPattern(List=multiplication_10, CullPattern=shift_4)
cull_23 = CullPattern(List=multiplication_10, CullPattern=shift_17)
cull_24 = CullPattern(List=multiplication_10, CullPattern=shift_18)
multiplication_11 = Multiplication(A=replace, B=expression_7)
cull_25 = CullPattern(List=multiplication_11, CullPattern=shift_20)
cull_26 = CullPattern(List=multiplication_11, CullPattern=shift_21)
cull_27 = CullPattern(List=multiplication_11, CullPattern=shift_23)
cull_28 = CullPattern(List=multiplication_11, CullPattern=shift_22)
cull_29 = CullPattern(List=multiplication_11, CullPattern=shift_19)
cull_30 = CullPattern(List=multiplication_11, CullPattern=shift_14)
cull_31 = CullPattern(List=multiplication_11, CullPattern=shift_2)
cull_32 = CullPattern(List=multiplication_11, CullPattern=shift_3)
cull_33 = CullPattern(List=multiplication_11, CullPattern=shift_6)
cull_34 = CullPattern(List=multiplication_11, CullPattern=shift_15)
cull_35 = CullPattern(List=multiplication_11, CullPattern=shift_18)
cull_36 = CullPattern(List=multiplication_11, CullPattern=shift_7)
cull_37 = CullPattern(List=multiplication_11, CullPattern=shift_8)
cull_38 = CullPattern(List=multiplication_11, CullPattern=shift_10)
cull_39 = CullPattern(List=multiplication_11, CullPattern=shift_13)
cull_40 = CullPattern(List=multiplication_11, CullPattern=shift_16)
cull_41 = CullPattern(List=multiplication_11, CullPattern=shift_17)
cull_42 = CullPattern(List=multiplication_11, CullPattern=shift)
cull_43 = CullPattern(List=multiplication_11, CullPattern=shift_11)
cull_44 = CullPattern(List=multiplication_11, CullPattern=panel_30)
cull_45 = CullPattern(List=multiplication_11, CullPattern=shift_5)
cull_46 = CullPattern(List=multiplication_11, CullPattern=shift_12)
cull_47 = CullPattern(List=multiplication_11, CullPattern=shift_9)
cull_48 = CullPattern(List=multiplication_11, CullPattern=shift_4)
multiplication_12 = Multiplication(A=replace_3, B=expression_7)
cull_49 = CullPattern(List=multiplication_12, CullPattern=shift_21)
cull_50 = CullPattern(List=multiplication_12, CullPattern=shift_22)
cull_51 = CullPattern(List=multiplication_12, CullPattern=shift_20)
cull_52 = CullPattern(List=multiplication_12, CullPattern=shift_19)
cull_53 = CullPattern(List=multiplication_12, CullPattern=shift_23)
cull_54 = CullPattern(List=multiplication_12, CullPattern=shift_14)
cull_55 = CullPattern(List=multiplication_12, CullPattern=shift_15)
cull_56 = CullPattern(List=multiplication_12, CullPattern=shift_16)
cull_57 = CullPattern(List=multiplication_12, CullPattern=shift_18)
cull_58 = CullPattern(List=multiplication_12, CullPattern=shift_2)
cull_59 = CullPattern(List=multiplication_12, CullPattern=shift_3)
cull_60 = CullPattern(List=multiplication_12, CullPattern=shift_6)
cull_61 = CullPattern(List=multiplication_12, CullPattern=shift)
cull_62 = CullPattern(List=multiplication_12, CullPattern=shift_7)
cull_63 = CullPattern(List=multiplication_12, CullPattern=shift_13)
cull_64 = CullPattern(List=multiplication_12, CullPattern=panel_30)
cull_65 = CullPattern(List=multiplication_12, CullPattern=shift_9)
cull_66 = CullPattern(List=multiplication_12, CullPattern=shift_17)
cull_67 = CullPattern(List=multiplication_12, CullPattern=shift_8)
cull_68 = CullPattern(List=multiplication_12, CullPattern=shift_10)
cull_69 = CullPattern(List=multiplication_12, CullPattern=shift_12)
cull_70 = CullPattern(List=multiplication_12, CullPattern=shift_5)
cull_71 = CullPattern(List=multiplication_12, CullPattern=shift_11)
cull_72 = CullPattern(List=multiplication_12, CullPattern=shift_4)
pt = ConstructPoint(XCoordinate=cull_29, YCoordinate=cull_21, ZCoordinate=cull_52)
pt_2 = ConstructPoint(XCoordinate=cull_27, YCoordinate=cull_15, ZCoordinate=cull_53)
pt_3 = ConstructPoint(XCoordinate=cull_35, YCoordinate=cull_24, ZCoordinate=cull_57)
pt_4 = ConstructPoint(XCoordinate=cull_25, YCoordinate=cull_13, ZCoordinate=cull_51)
pt_5 = ConstructPoint(XCoordinate=cull_28, YCoordinate=cull_6, ZCoordinate=cull_50)
pt_6 = ConstructPoint(XCoordinate=cull_39, YCoordinate=cull_12, ZCoordinate=cull_63)
pt_7 = ConstructPoint(XCoordinate=cull_26, YCoordinate=cull_14, ZCoordinate=cull_49)
pt_8 = ConstructPoint(XCoordinate=cull_40, YCoordinate=cull_20, ZCoordinate=cull_56)
pt_9 = ConstructPoint(XCoordinate=cull_41, YCoordinate=cull_23, ZCoordinate=cull_66)
pt_10 = ConstructPoint(XCoordinate=cull_30, YCoordinate=cull_17, ZCoordinate=cull_54)
pt_11 = ConstructPoint(XCoordinate=cull_34, YCoordinate=cull_18, ZCoordinate=cull_55)
pt_12 = ConstructPoint(XCoordinate=cull_43, YCoordinate=cull_5, ZCoordinate=cull_71)
pt_13 = ConstructPoint(XCoordinate=cull_46, YCoordinate=cull_11, ZCoordinate=cull_69)
pt_14 = ConstructPoint(XCoordinate=cull_47, YCoordinate=cull_4, ZCoordinate=cull_65)
pt_15 = ConstructPoint(XCoordinate=cull_38, YCoordinate=cull_3, ZCoordinate=cull_68)
pt_16 = ConstructPoint(XCoordinate=cull_37, YCoordinate=cull_2, ZCoordinate=cull_67)
pt_17 = ConstructPoint(XCoordinate=cull_31, YCoordinate=cull_16, ZCoordinate=cull_58)
pt_18 = ConstructPoint(XCoordinate=cull_36, YCoordinate=cull, ZCoordinate=cull_62)
pt_19 = ConstructPoint(XCoordinate=cull_32, YCoordinate=cull_10, ZCoordinate=cull_59)
pt_20 = ConstructPoint(XCoordinate=cull_42, YCoordinate=cull_9, ZCoordinate=cull_61)
pt_21 = ConstructPoint(XCoordinate=cull_33, YCoordinate=cull_8, ZCoordinate=cull_60)
pt_22 = ConstructPoint(XCoordinate=cull_44, YCoordinate=cull_19, ZCoordinate=cull_64)
pt_23 = ConstructPoint(XCoordinate=cull_48, YCoordinate=cull_22, ZCoordinate=cull_72)
pt_24 = ConstructPoint(XCoordinate=cull_45, YCoordinate=cull_7, ZCoordinate=cull_70)
sort = SortList(Keys=cull_9, ValuesA=pt_20)  # -> Keys, ValuesA
sort_2 = SortList(Keys=cull_4, ValuesA=pt_14)  # -> Keys, ValuesA
sort_3 = SortList(Keys=cull_16, ValuesA=pt_17)  # -> Keys, ValuesA
sort_4 = SortList(Keys=cull_3, ValuesA=pt_15)  # -> Keys, ValuesA
sort_5 = SortList(Keys=cull_23, ValuesA=pt_9)  # -> Keys, ValuesA
sort_6 = SortList(Keys=cull_24, ValuesA=pt_3)  # -> Keys, ValuesA
sort_7 = SortList(Keys=cull_10, ValuesA=pt_19)  # -> Keys, ValuesA
sort_8 = SortList(Keys=cull_7, ValuesA=pt_24)  # -> Keys, ValuesA
sort_9 = SortList(Keys=cull_8, ValuesA=pt_21)  # -> Keys, ValuesA
sort_10 = SortList(Keys=cull_5, ValuesA=pt_12)  # -> Keys, ValuesA
sort_11 = SortList(Keys=cull_12, ValuesA=pt_6)  # -> Keys, ValuesA
sort_12 = SortList(Keys=cull_17, ValuesA=pt_10)  # -> Keys, ValuesA
sort_13 = SortList(Keys=cull_19, ValuesA=pt_22)  # -> Keys, ValuesA
sort_14 = SortList(Keys=cull_22, ValuesA=pt_23)  # -> Keys, ValuesA
sort_15 = SortList(Keys=cull_2, ValuesA=pt_16)  # -> Keys, ValuesA
sort_16 = SortList(Keys=cull_11, ValuesA=pt_13)  # -> Keys, ValuesA
sort_17 = SortList(Keys=cull_21, ValuesA=pt)  # -> Keys, ValuesA
sort_18 = SortList(Keys=cull_14, ValuesA=pt_7)  # -> Keys, ValuesA
sort_19 = SortList(Keys=cull_6, ValuesA=pt_5)  # -> Keys, ValuesA
sort_20 = SortList(Keys=cull_20, ValuesA=pt_8)  # -> Keys, ValuesA
sort_21 = SortList(Keys=cull_13, ValuesA=pt_4)  # -> Keys, ValuesA
sort_22 = SortList(Keys=cull, ValuesA=pt_18)  # -> Keys, ValuesA
sort_23 = SortList(Keys=cull_18, ValuesA=pt_11)  # -> Keys, ValuesA
sort_24 = SortList(Keys=cull_15, ValuesA=pt_2)  # -> Keys, ValuesA
cullpt = CullDuplicates(Points=sort.ValuesA, Tolerance=0.1, CullMode=3)  # -> Points, Indices, Valence
lng = ListLength(List=cullpt.Points)
cullpt_2 = CullDuplicates(Points=sort_2.ValuesA, Tolerance=0.1, CullMode=3)  # -> Points, Indices, Valence
lng_2 = ListLength(List=cullpt_2.Points)
cullpt_3 = CullDuplicates(Points=sort_3.ValuesA, Tolerance=0.1, CullMode=3)  # -> Points, Indices, Valence
lng_3 = ListLength(List=cullpt_3.Points)
cullpt_4 = CullDuplicates(Points=sort_4.ValuesA, Tolerance=0.1, CullMode=3)  # -> Points, Indices, Valence
lng_4 = ListLength(List=cullpt_4.Points)
cullpt_5 = CullDuplicates(Points=sort_5.ValuesA, Tolerance=0.1, CullMode=3)  # -> Points, Indices, Valence
lng_5 = ListLength(List=cullpt_5.Points)
cullpt_6 = CullDuplicates(Points=sort_6.ValuesA, Tolerance=0.1, CullMode=3)  # -> Points, Indices, Valence
lng_6 = ListLength(List=cullpt_6.Points)
cullpt_7 = CullDuplicates(Points=sort_7.ValuesA, Tolerance=0.1, CullMode=3)  # -> Points, Indices, Valence
lng_7 = ListLength(List=cullpt_7.Points)
cullpt_8 = CullDuplicates(Points=sort_8.ValuesA, Tolerance=0.1, CullMode=3)  # -> Points, Indices, Valence
lng_8 = ListLength(List=cullpt_8.Points)
cullpt_9 = CullDuplicates(Points=sort_9.ValuesA, Tolerance=0.1, CullMode=3)  # -> Points, Indices, Valence
lng_9 = ListLength(List=cullpt_9.Points)
cullpt_10 = CullDuplicates(Points=sort_10.ValuesA, Tolerance=0.1, CullMode=3)  # -> Points, Indices, Valence
lng_10 = ListLength(List=cullpt_10.Points)
cullpt_11 = CullDuplicates(Points=sort_11.ValuesA, Tolerance=0.1, CullMode=3)  # -> Points, Indices, Valence
lng_11 = ListLength(List=cullpt_11.Points)
cullpt_12 = CullDuplicates(Points=sort_12.ValuesA, Tolerance=0.1, CullMode=3)  # -> Points, Indices, Valence
lng_12 = ListLength(List=cullpt_12.Points)
cullpt_13 = CullDuplicates(Points=sort_13.ValuesA, Tolerance=0.1, CullMode=3)  # -> Points, Indices, Valence
lng_13 = ListLength(List=cullpt_13.Points)
subtraction = Subtraction(A=lng, B=Slider(2, range=0..10))
cullpt_14 = CullDuplicates(Points=sort_14.ValuesA, Tolerance=0.1, CullMode=3)  # -> Points, Indices, Valence
lng_14 = ListLength(List=cullpt_14.Points)
cullpt_15 = CullDuplicates(Points=sort_15.ValuesA, Tolerance=0.1, CullMode=3)  # -> Points, Indices, Valence
lng_15 = ListLength(List=cullpt_15.Points)
cullpt_16 = CullDuplicates(Points=sort_16.ValuesA, Tolerance=0.1, CullMode=3)  # -> Points, Indices, Valence
lng_16 = ListLength(List=cullpt_16.Points)
subtraction_2 = Subtraction(A=lng_5, B=Slider(2, range=0..10))
cullpt_17 = CullDuplicates(Points=sort_17.ValuesA, Tolerance=0.1, CullMode=3)  # -> Points, Indices, Valence
lng_17 = ListLength(List=cullpt_17.Points)
cullpt_18 = CullDuplicates(Points=sort_18.ValuesA, Tolerance=0.1, CullMode=3)  # -> Points, Indices, Valence
lng_18 = ListLength(List=cullpt_18.Points)
cullpt_19 = CullDuplicates(Points=sort_19.ValuesA, Tolerance=0.1, CullMode=3)  # -> Points, Indices, Valence
lng_19 = ListLength(List=cullpt_19.Points)
subtraction_3 = Subtraction(A=lng_7, B=Slider(2, range=0..10))
subtraction_4 = Subtraction(A=lng_4, B=Slider(2, range=0..10))
cullpt_20 = CullDuplicates(Points=sort_20.ValuesA, Tolerance=0.1, CullMode=3)  # -> Points, Indices, Valence
lng_20 = ListLength(List=cullpt_20.Points)
cullpt_21 = CullDuplicates(Points=sort_21.ValuesA, Tolerance=0.1, CullMode=3)  # -> Points, Indices, Valence
lng_21 = ListLength(List=cullpt_21.Points)
subtraction_5 = Subtraction(A=lng_13, B=Slider(2, range=0..10))
subtraction_6 = Subtraction(A=lng_3, B=Slider(2, range=0..10))
cullpt_22 = CullDuplicates(Points=sort_22.ValuesA, Tolerance=0.1, CullMode=3)  # -> Points, Indices, Valence
lng_22 = ListLength(List=cullpt_22.Points)
subtraction_7 = Subtraction(A=lng_15, B=Slider(2, range=0..10))
subtraction_8 = Subtraction(A=lng_2, B=Slider(2, range=0..10))
subtraction_9 = Subtraction(A=lng_16, B=Slider(2, range=0..10))
cullpt_23 = CullDuplicates(Points=sort_23.ValuesA, Tolerance=0.1, CullMode=3)  # -> Points, Indices, Valence
lng_23 = ListLength(List=cullpt_23.Points)
subtraction_10 = Subtraction(A=lng_6, B=Slider(2, range=0..10))
subtraction_11 = Subtraction(A=lng_18, B=Slider(2, range=0..10))
subtraction_12 = Subtraction(A=lng_14, B=Slider(2, range=0..10))
subtraction_13 = Subtraction(A=lng_9, B=Slider(2, range=0..10))
subtraction_14 = Subtraction(A=lng_10, B=Slider(2, range=0..10))
cullpt_24 = CullDuplicates(Points=sort_24.ValuesA, Tolerance=0.1, CullMode=3)  # -> Points, Indices, Valence
lng_24 = ListLength(List=cullpt_24.Points)
subtraction_15 = Subtraction(A=lng_8, B=Slider(2, range=0..10))
subtraction_16 = Subtraction(A=lng_22, B=Slider(2, range=0..10))
subtraction_17 = Subtraction(A=lng_11, B=Slider(2, range=0..10))
subtraction_18 = Subtraction(A=lng_23, B=Slider(2, range=0..10))
subtraction_19 = Subtraction(A=lng_19, B=Slider(2, range=0..10))
subtraction_20 = Subtraction(A=lng_12, B=Slider(2, range=0..10))
subtraction_21 = Subtraction(A=lng_20, B=Slider(2, range=0..10))
subtraction_22 = Subtraction(A=lng_17, B=Slider(2, range=0..10))
subtraction_23 = Subtraction(A=lng_21, B=Slider(2, range=0..10))
subtraction_24 = Subtraction(A=lng_24, B=Slider(2, range=0..10))
item_6 = ListItem(List=cullpt.Points, Index=Slider(0, range=0..100), Wrap=True)
item_7 = ListItem(List=cullpt.Points, Index=subtraction, Wrap=True)
item_8 = ListItem(List=cullpt_2.Points, Index=Slider(0, range=0..100), Wrap=True)
item_9 = ListItem(List=cullpt_2.Points, Index=subtraction_8, Wrap=True)
item_10 = ListItem(List=cullpt_3.Points, Index=Slider(0, range=0..100), Wrap=True)
item_11 = ListItem(List=cullpt_3.Points, Index=subtraction_6, Wrap=True)
item_12 = ListItem(List=cullpt_4.Points, Index=Slider(0, range=0..100), Wrap=True)
item_13 = ListItem(List=cullpt_4.Points, Index=subtraction_4, Wrap=True)
item_14 = ListItem(List=cullpt_5.Points, Index=Slider(0, range=0..100), Wrap=True)
item_15 = ListItem(List=cullpt_5.Points, Index=subtraction_2, Wrap=True)
item_16 = ListItem(List=cullpt_6.Points, Index=Slider(0, range=0..100), Wrap=True)
item_17 = ListItem(List=cullpt_6.Points, Index=subtraction_10, Wrap=True)
item_18 = ListItem(List=cullpt_7.Points, Index=Slider(0, range=0..100), Wrap=True)
item_19 = ListItem(List=cullpt_7.Points, Index=subtraction_3, Wrap=True)
item_20 = ListItem(List=cullpt_8.Points, Index=Slider(0, range=0..100), Wrap=True)
item_21 = ListItem(List=cullpt_8.Points, Index=subtraction_15, Wrap=True)
item_22 = ListItem(List=cullpt_9.Points, Index=Slider(0, range=0..100), Wrap=True)
item_23 = ListItem(List=cullpt_9.Points, Index=subtraction_13, Wrap=True)
item_24 = ListItem(List=cullpt_10.Points, Index=Slider(0, range=0..100), Wrap=True)
item_25 = ListItem(List=cullpt_10.Points, Index=subtraction_14, Wrap=True)
item_26 = ListItem(List=cullpt_11.Points, Index=Slider(0, range=0..100), Wrap=True)
item_27 = ListItem(List=cullpt_11.Points, Index=subtraction_17, Wrap=True)
item_28 = ListItem(List=cullpt_12.Points, Index=Slider(0, range=0..100), Wrap=True)
item_29 = ListItem(List=cullpt_12.Points, Index=subtraction_20, Wrap=True)
item_30 = ListItem(List=cullpt_13.Points, Index=Slider(0, range=0..100), Wrap=True)
item_31 = ListItem(List=cullpt_13.Points, Index=subtraction_5, Wrap=True)
item_32 = ListItem(List=cullpt_14.Points, Index=Slider(0, range=0..100), Wrap=True)
item_33 = ListItem(List=cullpt_14.Points, Index=subtraction_12, Wrap=True)
item_34 = ListItem(List=cullpt_15.Points, Index=Slider(0, range=0..100), Wrap=True)
item_35 = ListItem(List=cullpt_15.Points, Index=subtraction_7, Wrap=True)
item_36 = ListItem(List=cullpt_16.Points, Index=Slider(0, range=0..100), Wrap=True)
item_37 = ListItem(List=cullpt_16.Points, Index=subtraction_9, Wrap=True)
item_38 = ListItem(List=cullpt_17.Points, Index=Slider(0, range=0..100), Wrap=True)
item_39 = ListItem(List=cullpt_17.Points, Index=subtraction_22, Wrap=True)
item_40 = ListItem(List=cullpt_18.Points, Index=Slider(0, range=0..100), Wrap=True)
item_41 = ListItem(List=cullpt_18.Points, Index=subtraction_11, Wrap=True)
item_42 = ListItem(List=cullpt_19.Points, Index=Slider(0, range=0..100), Wrap=True)
item_43 = ListItem(List=cullpt_19.Points, Index=subtraction_19, Wrap=True)
item_44 = ListItem(List=cullpt_20.Points, Index=Slider(0, range=0..100), Wrap=True)
item_45 = ListItem(List=cullpt_20.Points, Index=subtraction_21, Wrap=True)
item_46 = ListItem(List=cullpt_21.Points, Index=Slider(0, range=0..100), Wrap=True)
item_47 = ListItem(List=cullpt_21.Points, Index=subtraction_23, Wrap=True)
item_48 = ListItem(List=cullpt_22.Points, Index=Slider(0, range=0..100), Wrap=True)
item_49 = ListItem(List=cullpt_22.Points, Index=subtraction_16, Wrap=True)
item_50 = ListItem(List=cullpt_23.Points, Index=Slider(0, range=0..100), Wrap=True)
item_51 = ListItem(List=cullpt_23.Points, Index=subtraction_18, Wrap=True)
item_52 = ListItem(List=cullpt_24.Points, Index=Slider(0, range=0..100), Wrap=True)
item_53 = ListItem(List=cullpt_24.Points, Index=subtraction_24, Wrap=True)
entwine_2 = Entwine(
    Branch00=[item_30, item_6, item_10, item_18, item_32, item_20, item_22, item_48, item_34, item_8, item_12, item_24, item_36, item_26, item_28, item_50, item_44, item_14, item_16, item_38, item_46, item_40, item_42, item_52],
    FlattenInputs=True)
entwine_3 = Entwine(
    Branch00=[item_31, item_7, item_11, item_19, item_33, item_21, item_23, item_49, item_35, item_9, item_13, item_25, item_37, item_27, item_29, item_51, item_45, item_15, item_17, item_39, item_47, item_41, item_43, item_53],
    FlattenInputs=True)
cullpt_25 = CullDuplicates(Points=entwine_2, Tolerance=0.1, CullMode=3)  # -> Points, Indices, Valence
cullpt_26 = CullDuplicates(Points=entwine_3, Tolerance=0.1, CullMode=3)  # -> Points, Indices, Valence

panel_52 = Panel(ma_2.Result)
panel_53 = Panel(ma_4.Result)
panel_54 = Panel(ma_5.Result)
panel_55 = Panel(ma_3.Result)
subtraction_25 = Subtraction(A=panel_52, B=panel_53)
subtraction_26 = Subtraction(A=panel_54, B=panel_55)
addition_6 = Addition(A=panel_52, B=panel_55)
addition_7 = Addition(A=panel_53, B=panel_54)
subtraction_27 = Subtraction(A=addition_6, B=addition_7)
setchart = SetChartContents(ChartToModify=chart, NewChartValues=[panel_55, subtraction_25], NewChartNames=["Cooling Load", "Cooling Load Saved"])
setchart_2 = SetChartContents(
    ChartToModify=chart_2,
    NewChartValues=[panel_53, subtraction_26],
    NewChartNames=["Baseline Heating Load", "Heating Load Increase"])
setchart_3 = SetChartContents(ChartToModify=chart_3, NewChartValues=[addition_7, subtraction_27])
shift_24 = ShiftList(List=cullpt_26.Points, Shift=Slider(-1, range=-1..1), Wrap=True)
shift_25 = ShiftList(List=cullpt_25.Points, Shift=Slider(-1, range=-1..1), Wrap=True)
cull_73 = CullPattern(
    List=shift_24,
    CullPattern=[False, True, True, True, True, True, True, True, True, True, True, True, True, True, True, True, True, True, True, True, True, True, True])
cull_74 = CullPattern(
    List=shift_25,
    CullPattern=[False, True, True, True, True, True, True, True, True, True, True, True, True, True, True, True, True, True, True, True, True, True, True])

rev = ReverseList(List=cull_74)
pt_25 = Point(cull_73)
pt_26 = Point(rev)
pt_27 = Point(rev)
pline = PolyLine(Vertices=[pt_26, pt_25, pt_27], Closed=False)
crv_2 = Curve(pline)
divide = DivideCurve(Curve=crv_2, Count=values_8.Values, Kinks=False)  # -> Points, Tangents, Parameters
boundary = BoundarySurfaces(Edges=crv_2)
sdivide = DivideSurface(Surface=boundary, UCount=values_9.Values, VCount=values_9.Values)  # -> Points, Normals, Parameters
merge = Merge(Data1=divide.Points, Data2=sdivide.Points)  # -> flatten(Result)
pdecon = Deconstruct(Point=flatten(merge))  # -> flatten(XComponent), flatten(YComponent), flatten(ZComponent)
vec_2 = VectorXYZ(XComponent=pdecon.XComponent, YComponent=pdecon.YComponent, ZComponent=pdecon.ZComponent)  # -> Vector, Length
extr = Extrude(Base=crv, Direction=vec_2.Vector)
cap = CapHoles(Brep=extr)

sunion = SolidUnion(Breps=cap)
panel_56 = Panel(division_6)
panel_57 = Panel(division_4)
panel_58 = Panel(division_5)
panel_59 = Panel(ma_2.Result)
panel_60 = Panel(ma_4.Result)
panel_61 = Panel(ma_3.Result)
panel_62 = Panel(ma_5.Result)

nullrep_3 = ReplaceNulls(Items=panel_58, Replacements=Slider(0, range=0..100))  # -> Items, Count
bake = ObjectBake(
    BakeToggle=values_3.Values,
    GeometryObjects=sunion,
    Layer="3D Mask",
    ObjectName="GH_Obj",
    ObjectColor=RGB(255, 255, 255),
    LayerColor=RGB(255, 255, 255))
